# Grasshopper definition read_data.gh (Grasshopper 1.0.8)

depth_domain_size_2 = Slider(0.2, range=0..1)
x_domain_size_2 = Slider(0.9, range=0..10)
y_domain_size_2 = Slider(0.6, range=0..10)

py3 = Python3Script(run=Toggle(False), rec=Toggle(True), ms=Slider(100, range=0..1000), lim="500")  # -> out, Vs, Ds; inputs run: Boolean, rec: Boolean, ms: Int32, lim: Int32
# ---------- py3: Python ----------
import socket
import Rhino
import scriptcontext as sc

UDP_IP = "127.0.0.1"
UDP_PORT_IN = 5005
UDP_PORT_OUT = 5006


# ---- Inputs safety ----
if 'ms' not in globals() or ms is None:
    ms = 10
if 'MAX' not in globals() or lim is None:
    MAX = 0  # 0 = unlimited

# ---- Socket init (persistent) ----
if "gaze_socket" not in sc.sticky:
    sock = socket.socket(socket.AF_INET, socket.SOCK_DGRAM)
    try:
        sock.setsockopt(socket.SOL_SOCKET, socket.SO_REUSEADDR, 1)
    except:
        pass
    sock.bind((UDP_IP, UDP_PORT_IN))
    sock.setblocking(False)
    sc.sticky["gaze_socket"] = sock

sock = sc.sticky["gaze_socket"]

# ---- Persistent State ----
if "gaze_vector" not in sc.sticky:
    sc.sticky["gaze_vector"] = (0.0, 0.0, 1.0)

if "gaze_depth" not in sc.sticky:
    sc.sticky["gaze_depth"] = 0.0

if "gaze_Vs" not in sc.sticky:
    sc.sticky["gaze_Vs"] = []

if "gaze_Ds" not in sc.sticky:
    sc.sticky["gaze_Ds"] = []

if "gaze_prev_run" not in sc.sticky:
    sc.sticky["gaze_prev_run"] = False

if "gaze_recording" not in sc.sticky:
    sc.sticky["gaze_recording"] = False


# ---- Scheduling ----
def schedule_next(delay_ms=10):
    ghdoc = ghenv.Component.OnPingDocument()
    if ghdoc is None:
        return
    def cb(doc):
        try:
            ghenv.Component.ExpireSolution(False)
        except:
            pass
    ghdoc.ScheduleSolution(int(delay_ms), cb)


def drain_latest_packet(sock_obj):
    latest = None
    while True:
        try:
            data, addr = sock_obj.recvfrom(1024)
            latest = data
        except BlockingIOError:
            break
        except:
            break
    if latest is None:
        return None
    try:
        return latest.decode("utf-8").strip()
    except:
        return None


# ---- Rising edge detection ----
prev_run = sc.sticky["gaze_prev_run"]

if run and not prev_run:
    # Reset buffers
    sc.sticky["gaze_Vs"] = []
    sc.sticky["gaze_Ds"] = []
    sc.sticky["gaze_vector"] = (0.0, 0.0, 1.0)
    sc.sticky["gaze_depth"] = 0.0
    sc.sticky["gaze_recording"] = True


# ---- Recording logic ----
isRecording = sc.sticky["gaze_recording"]

sock_out = socket.socket(socket.AF_INET, socket.SOCK_DGRAM)

if run and isRecording:

    if rec:
        sock_out.sendto("START".encode("utf-8"), (UDP_IP, UDP_PORT_OUT))

    msg = drain_latest_packet(sock)

    if msg is not None:
        parts = msg.split(",")
        if len(parts) >= 4:
            try:
                x = float(parts[0])
                y = float(parts[1])
                z = float(parts[2])
                d = float(parts[3])

                sc.sticky["gaze_vector"] = (x, y, z)
                sc.sticky["gaze_depth"] = d

                Vs = sc.sticky["gaze_Vs"]
                Ds = sc.sticky["gaze_Ds"]

                Vs.append(Rhino.Geometry.Vector3d(x, y, z))
                Ds.append(d)

                # ---- MAX stop condition ----
                if MAX > 0 and len(Vs) >= MAX:
                    sc.sticky["gaze_recording"] = False
                else:
                    schedule_next(ms)

            except:
                schedule_next(ms)
        else:
            schedule_next(ms)
    else:
        # No packet this tick — continue loop
        schedule_next(ms)

if not run:
    sock_out.sendto("STOP".encode("utf-8"), (UDP_IP, UDP_PORT_OUT))

# ---- Update previous run state ----
sc.sticky["gaze_prev_run"] = bool(run)

# ---- Outputs ----
x, y, z = sc.sticky["gaze_vector"]
D = sc.sticky["gaze_depth"]

V = Rhino.Geometry.Vector3d(x, y, z)
Vs = sc.sticky["gaze_Vs"]
Ds = sc.sticky["gaze_Ds"]

count = len(Vs)
isRecording = sc.sticky["gaze_recording"]

raw = f"{x:.3f}, {y:.3f}, {z:.3f}, d={D:.3f} | n={count}"
# ---------- end py3 ----------

viewports = QueryViewports(Name="Perspective", AutoUpdateState=True)
view = ModelView(View=viewports)  # -> View, Title, Perspective, Location, Target, XExtents, YExtents
vec = Vector(py3.Vs)
num = Number(py3.Ds)
item = ListItem(List=num, Index=0, Wrap=True)
subtraction = Subtraction(A=item, B=num)
deplane = DeconstructPlane(Plane=view.Location)  # -> Origin, XAxis, YAxis, ZAxis
depth = Number(depth_domain_size_2)
devec = DeconstructVector(Vector=vec)  # -> XComponent, YComponent, ZComponent
dom = ConstructDomain(DomainStart=expr("1-x", depth), DomainEnd=expr("1+x", depth))
bnd = Bounds(Numbers=subtraction)
neg = Negative(Value=devec.XComponent)
neg_2 = Negative(Value=devec.YComponent)
amp = Amplitude(Vector=deplane.ZAxis, Amplitude=view.Target)
remap = RemapNumbers(Value=subtraction, Source=bnd, Target=dom)  # -> Mapped, Clipped
neg_3 = Negative(Value=amp)
vec_2 = VectorXYZ(XComponent=neg, YComponent=neg_2, ZComponent=devec.ZComponent)  # -> Vector, Length
num_2 = Number(x_domain_size_2)
num_3 = Number(y_domain_size_2)
multiplication = Multiplication(A=remap.Mapped, B=neg_3)
dom_2 = ConstructDomain(DomainStart=num_2, DomainEnd=expr("-x", num_2))
dom_3 = ConstructDomain(DomainStart=num_3, DomainEnd=expr("-x", num_3))
move = Move(Geometry=view.Location, Motion=multiplication)  # -> Geometry, Transform
rectangle = Rectangle(Plane=move.Geometry, XSize=view.XExtents, YSize=view.YExtents, Radius=0)  # -> Rectangle, Length
rectangle_2 = Rectangle(Plane=PlaneXY(0, 0, 0), XSize=dom_2, YSize=dom_3, Radius=0)  # -> Rectangle, Length
rectangle_3 = Rectangle(Plane=PlaneXY(0, 0, 0), XSize="-1 to 1", YSize="-1 to 1", Radius=0)  # -> Rectangle, Length
evalsrf = EvaluateSurface(Surface=rectangle_3.Rectangle, Point=vec_2.Vector)  # -> Point, Normal, UDirection, VDirection, Frame
recmap = RectangleMapping(Geometry=evalsrf.Point, Source=rectangle_2.Rectangle, Target=rectangle.Rectangle)  # -> Geometry, Transform
recmap_2 = RectangleMapping(Geometry=rectangle_2.Rectangle, Source=rectangle_3.Rectangle, Target=rectangle.Rectangle)  # -> Geometry, Transform
